# Grasshopper definition Main.gh (Grasshopper 1.0.7)
# plug-ins: Human UI, DynaModel

# ---- group: Input Label
panel = Panel("------------------------------------Output--------------------------------------")
textsize = Slider(13, range=0..1000)
height = Slider(35, range=0..1000)
width = Slider(600, range=0..1000)
label = CreateLabel(LabelText=panel, LabelSize=textsize, Justification=0)
adjustpos = AdjustElementPositioning(ElementsToAdjust=label, Margin="60,10,5,10", AbsolutePositioning=False, Width=width, Height=height)

# ---- group: Main Window
launchwin = LaunchWindow(
    Show=Toggle(True),
    Name="3D Model Interaction Tool",
    Width=Slider(600, range=0..1000),
    Height=Slider(600, range=0..1000),
    ChildStatus=0,
    EnableHorizScroll=False)

# ---- group: Input Label
panel_2 = Panel("------------------------------------Input--------------------------------------")
textsize_2 = Slider(13, range=0..1000)
height_2 = Slider(35, range=0..1000)
width_2 = Slider(600, range=0..1000)
label_2 = CreateLabel(LabelText=panel_2, LabelSize=textsize_2, Justification=0)
adjustpos_2 = AdjustElementPositioning(ElementsToAdjust=label_2, Margin="60,10,5,10", AbsolutePositioning=False, Width=width_2, Height=height_2)

# ---- group: Type
panel_3 = Panel("""quick touch
Hold
Press""")
pulldown = CreatePulldownMenu(Label="Type:", ListItems=panel_3, showLabel=True)
setlist = SetListContents(ListToModify=panel_3)

panel_4 = Panel("""Speaker
LED Light
Vibration
Rotational Motion
Translational Motion""")
pulldown_2 = CreatePulldownMenu(Label="Output parameter", ListItems=panel_4, showLabel=True)
setlist_2 = SetListContents(ListToModify=panel_4)

# ---- group: Input Parameter Selection
panel_5 = Panel("""Touch
Button
Light Sensor
Voice
Bluetooth Control""")
pulldown_3 = CreatePulldownMenu(Label="Input parameter:", ListItems=panel_5, showLabel=True)
setlist_3 = SetListContents(ListToModify=panel_5)

# ----
brighness = Slider(10, range=0..10)
slider = CreateSlider(Slider=brighness, ShowBounds=False, ShowTicks=False, ShowTooltip=False, ShowValLabel=True, showLabel=True)
adjustpos_3 = AdjustElementPositioning(ElementsToAdjust=slider, Margin="0,30,0,0", AbsolutePositioning=False)

panel_6 = Panel("""Flash
Soft""")
pulldown_4 = CreatePulldownMenu(Label="Light Mode:", ListItems=panel_6, showLabel=True)
adjustpos_4 = AdjustElementPositioning(ElementsToAdjust=pulldown_4, Margin="-1,7,0,0", AbsolutePositioning=False)

values = ValueListener(Elements=pulldown_2, SomeProperty=True)  # -> Values, Indices
values_2 = ValueListener(Elements=pulldown, SomeProperty=True)  # -> Values, Indices
values_3 = ValueListener(Elements=pulldown_3, SomeProperty=True)  # -> Values, Indices

height_3 = Slider(50, range=0..50)
width_3 = Slider(100, range=0..100)
true_button = CreateTrueOnlyButton(ButtonName="Select & Create", ButtonStyle=0)
adjustpos_5 = AdjustElementPositioning(ElementsToAdjust=true_button, AbsolutePositioning=False, Width=width_3, Height=height_3)

merge = Merge(Data3=slider, Data4=pulldown_4, Data7=true_button)
values_4 = ValueListener(Elements=true_button, SomeProperty=True)  # -> Values, Indices
nickname = CreatePipe(StartButton=values_4.Values, InputType=values_3.Values, OutputType=values.Values)

# ---- group: Start button
panel_7 = Panel("Start")

# ----
true_button_2 = CreateTrueOnlyButton(ButtonName=panel_7, ButtonStyle=0)

# ---- group: Start button (continued)
adjustpos_6 = AdjustElementPositioning(
    ElementsToAdjust=true_button_2,
    AbsolutePositioning=False,
    Width=Slider(100, range=0..100),
    Height=Slider(50, range=0..100))
adjustelem = AdjustElementAppearance(ElementsToAdjust=true_button_2, FontSize=Slider(14, range=0..100))

# ----
values_5 = ValueListener(Elements=true_button_2, SomeProperty=True)  # -> Values, Indices

# ---- group: Main Window
launchwin_2 = LaunchWindow(
    Show=values_5.Values,
    Name="3D Model Interaction Tool",
    Width=Slider(600, range=0..1000),
    Height=Slider(600, range=0..1000),
    ChildStatus=0,
    EnableHorizScroll=False)

# ---- group: Elements that added to the Main Window
merge_2 = Merge(Data5=label_2, Data6=pulldown_3, Data7=pulldown, Data8=label, Data9=pulldown_2, Data10=true_button_2)
addelems = AddElements(Window=launchwin, Elements=flatten(merge_2), DoVLChecking=True)  # -> AddedElements, ElementNames

# ----
childwin = MakeChildWindow(ParentWindow=launchwin, ChildWindow=launchwin_2)

# ---- group: Elements that added to the Main Window
addelems_2 = AddElements(Window=launchwin_2, Elements=flatten(merge), DoVLChecking=True)  # -> AddedElements, ElementNames
